# Grasshopper definition small-backpack.gh (Grasshopper 1.0.7)
# plug-ins: Pufferfish

pt = Point(Point(125, 0, 0))
crv = Curve(<curve referenced from the Rhino model>)
crv_2 = Curve(<curve referenced from the Rhino model>)
crv_3 = Curve(<curve referenced from the Rhino model>)
yz = YZPlane(Origin=pt)
mirror = Mirror(Geometry=crv_3, Plane=yz)  # -> Geometry, Transform
loft = Loft(Curves=[crv, crv_2], Options={Adjust=False, Closed=False, LoftEnds=0, LoftSimp=0, LoftType=0, Rebuild=10, Refit=0.01})
loft_2 = Loft(
    Curves=[crv_3, mirror.Geometry],
    Options={Adjust=False, Closed=False, LoftEnds=0, LoftSimp=0, LoftType=0, Rebuild=10, Refit=0.01})
bbx = BrepBrep(BrepA=loft, BrepB=loft_2)  # -> Curves, Points
srfsplit = SurfaceSplit(Surface=loft, Curves=bbx.Curves)
mirror_2 = Mirror(Geometry=bbx.Curves, Plane=yz)  # -> Geometry, Transform
item = ListItem(List=srfsplit, Index=0, Wrap=True)
loft_3 = Loft(
    Curves=[bbx.Curves, mirror_2.Geometry],
    Options={Adjust=False, Closed=False, LoftEnds=0, LoftSimp=0, LoftType=0, Rebuild=10, Refit=0.01})
mirror_3 = Mirror(Geometry=item, Plane=yz)  # -> Geometry, Transform
edgeslin = EdgesFromLinearity(Brep=item, Minimum=0, Maximum=1)  # -> Edges, Indices
item_2 = ListItem(List=edgeslin.Edges, Index=0, Wrap=True)  # -> Item, Item1
mirror_4 = Mirror(Geometry=item_2.Item, Plane=yz)  # -> Geometry, Transform
mirror_5 = Mirror(Geometry=item_2.Item1, Plane=yz)  # -> Geometry, Transform
crv_4 = Curve(<curve referenced from the Rhino model>)
loft_4 = Loft(
    Curves=[item_2.Item, mirror_4.Geometry],
    Options={Adjust=False, Closed=False, LoftEnds=0, LoftSimp=0, LoftType=0, Rebuild=10, Refit=0.01})
loft_5 = Loft(
    Curves=[item_2.Item1, mirror_5.Geometry],
    Options={Adjust=False, Closed=False, LoftEnds=0, LoftSimp=0, LoftType=0, Rebuild=10, Refit=0.01})
mirror_6 = Mirror(Geometry=crv_4, Plane=yz)  # -> Geometry, Transform
back = Surface(loft_5)
left = Surface(mirror_3.Geometry)
front = Surface(loft_4)
right = Surface(item)
bottom = Surface(loft_3)
loft_6 = Loft(
    Curves=[mirror_6.Geometry, crv_4],
    Options={Adjust=False, Closed=False, LoftEnds=0, LoftSimp=0, LoftType=0, Rebuild=10, Refit=0.01})
pt_2 = Point(Point(0, 0, 400))
xy = XYPlane(Origin=pt_2)
bbx_2 = BrepBrep(BrepA=right, BrepB=loft_6)  # -> Curves, Points
sec = BrepPlane(Brep=back, Plane=xy)  # -> Curves, Points
sec_2 = BrepPlane(Brep=[left, front, right], Plane=xy)  # -> Curves, Points
srfsplit_2 = SurfaceSplit(Surface=right, Curves=bbx_2.Curves)
join = JoinCurves(Curves=flatten(sec_2.Curves), Preserve=False)
Z = UnitZ(Factor=Slider(200, range=0..1000))
item_3 = ListItem(List=srfsplit_2, Index=0, Wrap=True)  # -> Item, Item1
extr = Extrude(Base=join, Direction=Z)
extr_2 = Extrude(Base=sec.Curves, Direction=Z)
side_pocket = Surface(item_3.Item1)
X = UnitX(Factor=Slider(427, range=0..1000))
roll_front_and_side = Surface(extr)
xy_2 = XYPlane(Origin=X)
roll_back = Surface(extr_2)
all_panels = Surface(flatten([right, bottom, left, back, front, roll_back, roll_front_and_side, side_pocket]))
lng = ListLength(List=all_panels)
arrlinear = LinearArray(Geometry=xy_2, Direction=X, Count=lng)  # -> Geometry, Transform
unrollpsrf = UnrollPolysurface(Polysurface=all_panels, Plane=arrlinear.Geometry)  # -> Unrolled, UnrolledPoints, UnrolledCurves
debrep = DeconstructBrep(Brep=unrollpsrf.Unrolled)  # -> Faces, Edges, Vertices
join_2 = JoinCurves(Curves=debrep.Edges, Preserve=False)
crv_5 = Curve(flatten(join_2))
